# Grasshopper definition mobius.gh (Grasshopper 0.9.76)
# plug-ins: Biomorpher, MeshEdit Components, LunchBox, Weaverbird

number_slider = Slider(1, range=0..5)
number_slider_2 = Slider(20, range=0..100)
number_slider_3 = Slider(7, range=2..10)
number_slider_4 = Slider(94, range=29..100)
mobius = MobiusSurface(
    UDivisions=number_slider_2,
    VDivisions=number_slider_2,
    RParameter=4,
    TParameter=number_slider,
    Scale=5,
    Domain1=Domain(-3.141592654, 3.141592654),
    Domain2=Domain(-1, 1))
number_slider_5 = Slider(20, range=2..50)
hex = HexagonCells(Surface=mobius, UDivisions=number_slider_4, VDivisions=number_slider_3, TParameter=0.25)  # -> HexagonCells, Centers
number_slider_6 = Slider(2.6, range=0..10)
wbframe = WeaverbirdsPictureFrame(MeshPolylines=hex.HexagonCells, Distance=number_slider_5, InsetType=0)
wbthicken = WeaverbirdsMeshThicken(MeshCurves=wbframe, Distance=number_slider_6, OffsetType=0)
area = MeshArea(Mesh=wbthicken)  # -> Area, Centroid
biomorpher = Biomorpher(
    Sliders=[number_slider_6, number_slider, number_slider_3, number_slider_4, number_slider_5],
    Geometry=wbthicken,
    Performas=area.Area)
